# Grasshopper definition SDMMinSurf.ghx (Grasshopper 0.9.76)
# plug-ins: Python Interpreter

mesh = Mesh(<mesh referenced from the Rhino model>)
pressure = Slider(-2, range=-2..2)
crv = Curve([<curve referenced from the Rhino model> x4])
define_edges = PythonScript(mesh=mesh, cables=crv, qCables=Slider(10000, range=0..10000), fixedCableEnds=Toggle(True))  # -> SDMedges; inputs fixed: list, cables: list of Curve, qCables: list
# ---------- define_edges: Python ----------
"""
Wrapper block for defining the edges of the problem: cables and fixed-points
"""

import rhinoscriptsyntax as rs
import MeshMinimize as mm
from imp import reload

reload(mm)

class SDMedges:
    """
    Emulates a custom type for the edges of the problem
    """
    
    def __init__(self, cables, qCables, vertices, naked, fixed):
        """
        Initiate cables and edges with dedicated method from MeshMinimize
        """
        self.cables = cables
        self.qCables = qCables
        (self.ql, self.nCable, self.fixed) = mm.defineCables(cables, qCables, vertices, naked, fixed)
        
    def __str__(self):
        """Simple display for error checking"""
        str = ''
        for key in self.__dict__:
            str += "%s: %s\n" % (key, self.__dict__[key])
        return str
        
"""Create default fixed points parameter"""
if not fixed:
    if not cables:
        #Edges are fixed when no cables are defined
        fixed = rs.MeshNakedEdgePoints(mesh)
    else:
        #Fixed points will be defined by mm.defineCables, initialize to none fixed
        fixed = [False for i in rs.MeshVertices(mesh)]
        
"""Create default cables density parameter"""
if not qCables:
    #Default: 1
    qCables = [1 for i in cables]
elif len(qCables) == 1:
    #Allows to pass in one number for all cables
    qCables = [qCables[0] for i in cables]
        
        
SDMedges = SDMedges(
                cables,
                qCables,
                rs.MeshVertices(mesh),
                rs.MeshNakedEdgePoints(mesh),
                fixed
                )
# ---------- end define_edges ----------
sdm_options = PythonScript(
    lmax=Slider(0.01, range=0..0.01),
    itermax=Slider(50, range=0..100),
    speed=Slider(1, range=0..1),
    method="fixed-point",
    pressure=pressure)  # -> options; inputs itermax: Int32
# ---------- sdm_options: Python ----------
"""
Block externalizing options for the solver
"""

class SDMoptions:
    """
    Emulates a custom type to pass the options to the solver
    """
    
    def __init__(self, lmax, itermax, speed, method, pressure):
        self.lmax = lmax
        self.itermax = itermax
        self.speed = speed
        self.method = method
        self.pressure = pressure
        
    def __str__(self):
        """Simple display for error checking"""
        str = ''
        for key in self.__dict__:
            str += "%s: %s\n" % (key, self.__dict__[key])
        return str
            
options = SDMoptions(lmax, itermax, speed, method, pressure)
# ---------- end sdm_options ----------
panel = Panel(sdm_options)
define_problem = PythonScript(mesh=mesh, SDMedges=define_edges)  # -> SDMmesh; inputs mesh: Mesh
# ---------- define_problem: Python ----------
"""
Block for outsourcing the mesh problem definitions
"""

import rhinoscriptsyntax as rs

class SDMmesh:
    """
    Emulates a custom type to pass the mesh problem to the solver
    """
    
    def __init__(self, mesh, SDMedges, qs, reference):
        self.cables = SDMedges.cables
        self.fixed = SDMedges.fixed
        self.qs = qs
        self.ql = SDMedges.ql
        self.qCables = SDMedges.qCables
        self.nCable = SDMedges.nCable
        self.mesh = mesh
        self.reference = reference
        
    def __str__(self):
        """Simple display for error checking"""
        str = ''
        for key in self.__dict__:
            str += "%s: %s\n" % (key, self.__dict__[key])
        return str
        
        
#Create defaults (1) for the surface density
if not qs: qs = [1 for i in range(rs.MeshFaceCount(mesh))]

#Create defaults (current mesh) for the reference mesh
if not reference: reference = rs.MeshVertices(mesh)

SDMmesh = SDMmesh(mesh, SDMedges, qs, reference)
# ---------- end define_problem ----------
solver = PythonScript(toggle=Toggle(True), SDMmesh=define_problem, SDMcables=define_edges, options=sdm_options)  # -> meshOut, displacements; inputs toggle: Boolean, SDMcables: list
# ---------- solver: Python ----------
#!/usr/bin/env python
# -*- coding: utf-8 -*-

"""
Wrapper block encapsulating the MeshMinimize module
"""

from imp import reload
import MeshMinimize as mm
import rhinoscriptsyntax as rs
import ghpythonlib.components as ghcomp

reload(mm)

#Pass options to the MeshMinimize module
for key in options.__dict__:
    mm.__dict__[key] = options.__dict__[key]


if toggle:
    vertices = mm.minimizeMesh(
                    SDMmesh.mesh,
                    SDMmesh.cables, 
                    fixed=SDMmesh.fixed, 
                    qs=SDMmesh.qs, 
                    qCables=SDMmesh.qCables, 
                    reference=SDMmesh.reference, 
                    ql=SDMmesh.ql, 
                    nCable=SDMmesh.nCable,
                    P=options.pressure
                    )
else:
    vertices = rs.MeshVertices(SDMmesh.mesh)
    

meshOut = rs.AddMesh(vertices, rs.MeshFaceVertices(SDMmesh.mesh))

displacements = [rs.VectorCreate(v1, v2) for (v1, v2) in zip(rs.MeshVertices(SDMmesh.mesh), vertices)]
# ---------- end solver ----------
